# Grasshopper definition CW_GH.ghx (Grasshopper 1.0.8)
# plug-ins: Speckle 2, Kangaroo2 Components

panel = Panel("https://macad.speckle.xyz/projects/5df78e0744/models/dd92879736")  # disabled

# ---- group: RH_IN:Send
txt = Text()

# ----
node_levels = Geometry(Tree({0;0}: [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], {1;0}: [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], {2;0}: [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], {3;0}: [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], {4;0}: [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], {5;0}: [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], {6;0}: [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], {7;0}: [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]))
receive = Receive(
    Stream=panel,
    AutoReceive=True,
    CurrentComponentState="expired",
    ExpandOutput=True,
    LastInfoMessage="Marco Durand @ 03/21/2025 16:05:56: Pushed 18 elements from Grasshopper. (id:a55fb5681c)",
    ReceiveOnOpen=False,
    ReceivedCommitId="a55fb5681c",
    StreamWrapper="https://macad.speckle.xyz/projects/5df78e0744/models/send-to-compute",
    selectedKitName="Objects")  # -> Info, O; disabled

# ----
# SPECKLE IMPORT
sr = SynchronousReceiver(Stream=txt, AutoReceive=False, KitName="Objects", selectedKitName="Objects")  # -> Data, Info
sovk = SpeckleObjectValueByKey(Object=sr.Data, Key="Geo", selectedKitName="Objects")
geo = Geometry(simplify(sovk))

# ----
# EXOSKELETON CREATION
volume = Volume(Geometry=Tree({0;0}: [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], {1;0}: [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], {2;0}: [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], {3;0}: [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], {4;0}: [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], {5;0}: [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], {6;0}: [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], {7;0}: [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]))  # -> Volume, Centroid; disabled
triremesh = TriRemesh(Geometry=geo, Length=8, Iterations=25)  # -> Triangulation, Dual, Creases; disabled
box = CenterBox(Base=volume.Centroid, X=100, Y=100, Z=6)  # disabled
geo_2 = Geometry(triremesh.Dual)  # disabled
mesh = MeshBrep(
    Brep=box,
    Settings={GridMaxCount=0, GridMinCount=16, JaggedSeams=False, MaxEdgeLength=0, MinEdgeLength=0.0001, MinTolerance=0, Refine=True, RefineAngle=0, RelativeTolerance=0.65, SimplePlanes=True, Tolerance=0})  # disabled
mdif = MeshDifference(MeshesA=graft(geo_2), MeshesB=mesh)  # disabled
medges = MeshEdges(Mesh=mdif)  # -> NakedEdges, InteriorEdges, NonManifoldEdges; disabled
geo_3 = Geometry(simplify(medges.InteriorEdges))  # disabled

# ----
# SLAB CREATION
rectangle = Rectangle(
    Plane=Tree({0;0}: [PlaneXY(590.7776673, -331.0620895, 10.96325121), PlaneXY(592.0407639, -330.9996242, 14.96325121), PlaneXY(594.3840076, -330.5921729, 18.96325121), PlaneXY(597.4054328, -330.1213684, 22.96325121), PlaneXY(600.5099359, -329.3821662, 26.96325121), PlaneXY(603.6400515, -328.5560482, 30.96325121)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], {1;0}: [PlaneXY(607.4993175, -372.2187603, 344.2026762), PlaneXY(599.422828, -371.5687862, 348.2026762), PlaneXY(591.3530356, -371.0963788, 352.2026762), PlaneXY(583.0507517, -370.3985164, 356.2026762), PlaneXY(576.327285, -370.1582609, 360.2026762), PlaneXY(576.4530278, -369.9626963, 364.2026762)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], {2;0}: [PlaneXY(524.448578, -343.9139616, 81.213615), PlaneXY(526.904347, -339.9336614, 85.213615), PlaneXY(529.5220301, -337.457048, 89.213615), PlaneXY(532.1737113, -335.4528098, 93.213615), PlaneXY(534.8279425, -333.6543941, 97.213615), PlaneXY(537.4741512, -331.9622855, 101.213615)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], {3;0}: [PlaneXY(602.74469, -381.809695, 161.6054596), PlaneXY(601.7664775, -379.3521311, 165.6054596), PlaneXY(599.7280006, -377.8423132, 169.6054596), PlaneXY(597.4152471, -376.5507644, 173.6054596), PlaneXY(594.9398622, -375.3769329, 177.6054596), PlaneXY(592.8250914, -374.1374465, 181.6054596)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], {4;0}: [PlaneXY(523.6677428, -234.9167515, 247.8345121), PlaneXY(530.397852, -239.1335015, 251.8345121), PlaneXY(536.6440097, -240.407531, 255.8345121), PlaneXY(542.721414, -240.0278543, 259.8345121), PlaneXY(547.897966, -239.2870064, 263.8345121), PlaneXY(549.7018205, -239.2367292, 267.8345121)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], {5;0}: [PlaneXY(664.6502433, -289.4023978, 243.6649381), PlaneXY(662.4063012, -281.3805753, 247.6649381), PlaneXY(658.4233143, -276.9380002, 251.6649381), PlaneXY(653.5879285, -274.8110538, 255.6649381), PlaneXY(649.3793991, -273.1497612, 259.6649381), PlaneXY(646.1129898, -271.6514072, 263.6649381)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], {6;0}: [PlaneXY(594.4898244, -248.9774732, 12.68376052), PlaneXY(594.2658826, -248.6374479, 16.68376052), PlaneXY(593.9575196, -248.305494, 20.68376052), PlaneXY(593.5682978, -247.9763389, 24.68376052), PlaneXY(593.0973057, -247.6453825, 28.68376052), PlaneXY(592.5373032, -247.3096262, 32.68376052)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], {7;0}: [PlaneXY(657.561471, -250.1697172, 108.6118896), PlaneXY(652.6086886, -252.0913751, 112.6118896), PlaneXY(647.585129, -253.823354, 116.6118896), PlaneXY(642.507873, -255.5420024, 120.6118896), PlaneXY(637.3928864, -257.2573556, 124.6118896), PlaneXY(632.5808252, -258.899008, 128.6118896)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]),
    XSize=Domain(-100, 100),
    YSize=Domain(-100, 100),
    Radius=0)  # -> Rectangle, Length
mesh_2 = Mesh(geo)
sec = MeshPlane(Mesh=graft(mesh_2), Plane=rectangle.Rectangle)
offset = OffsetCurve(Curve=sec, Distance=-0.3, Corners=1)  # -> simplify(Curve)
boundary = BoundarySurfaces(Edges=offset)
geo_4 = Geometry(boundary)

# ---- group: RH_IN:Receive
txt_2 = Text()

# ----
panel_2 = Panel("https://macad.speckle.xyz/projects/3d647ccce7/models/929beaee52")  # disabled

# ----
# SPECKLE EXPORT
lng = ListLength(List=geo)
panel_3 = Panel("Bot Speckle Token")
sgetwt = StreamGetWithToken(Stream=txt_2, AuthToken="0a7a2c01a136ad89e2cfa5e002c9f1bcbe5656a1d0")

cso = CreateSpeckleObject(SLABS=offset, Fake_Cost=lng, selectedKitName="Objects")

# ---- group: RH_OUT:Cost
num = Number(lng)

# ----
ss = SynchronousSender(
    Data=cso,
    Stream=sgetwt,
    OutputWrappers="https://macad.speckle.xyz\t27b32e7bd2\tab5404b2dc",
    UseDefaultCache=True,
    selectedKitName="Objects")

send = Send(
    Stream=panel_2,
    Data=cso,
    AutoSend=True,
    BaseId="69bd8e3feece06bf303ebcac88be3443",
    CurrentComponentState="up_to_date",
    KitName="Objects",
    OutputWrappers="https://macad.speckle.xyz\t3d647ccce7\tcaee9e5e9c",
    UseDefaultCache=True,
    selectedKitName="Objects")  # disabled
